# Dynamo custom node Get Worksheet Names.dyf (Dynamo 1.1.0.2094)
# category: Archi-lab_Bumblebee.App
# This node will query an Excel file and return a list of sheet names that it contains.

FilePath = Input()
RunIt = Input(RunIt : bool = false)
python_script = Python(IN[0]=FilePath, IN[1]=RunIt)
# ---------- python_script.python (87 lines) ----------
# Copyright(c) 2016, David Mans, Konrad Sobon
# @arch_laboratory, http://archi-lab.net, http://neoarchaic.net

import clr
import sys
import System
from System import Array
from System.Collections.Generic import *

clr.AddReferenceByName('Microsoft.Office.Interop.Excel, Version=11.0.0.0, Culture=neutral, PublicKeyToken=71e9bce111e9429c')
from Microsoft.Office.Interop import Excel
System.Threading.Thread.CurrentThread.CurrentCulture = System.Globalization.CultureInfo("en-US")
from System.Runtime.InteropServices import Marshal

pyt_path = r'C:\Program Files (x86)\IronPython 2.7\Lib'
sys.path.append(pyt_path)

from os import path
assemblies = System.AppDomain.CurrentDomain.GetAssemblies()
path1 = [a.Location for a in assemblies if 'bbIcons,' in a.FullName][0]
path2 = System.IO.Path.GetDirectoryName(path1).rsplit('\\',1)[0]
bb_path = '%s\\extra\\' %path2
sys.path.append(bb_path)
import bumblebee as bb

#The inputs to this node will be stored as a list in the IN variable.
dataEnteringNode = IN

filePath = IN[0]
runMe = IN[1]

if filePath != None:
	if filePath.GetType() == System.IO.FileInfo:
		filePath = filePath.FullName

def SetUp(xlApp):
	# supress updates and warning pop ups
	xlApp.Visible = False
	xlApp.DisplayAlerts = False
	xlApp.ScreenUpdating = False
	return xlApp

def ExitExcel(xlApp, wb):
	# clean up before exiting excel, if any COM object remains
	# unreleased then excel crashes on open following time
	def CleanUp(_list):
		if isinstance(_list, list):
			for i in _list:
				Marshal.ReleaseComObject(i)
		else:
			Marshal.ReleaseComObject(_list)
		return None
		
	xlApp.ActiveWorkbook.Close(False)
	xlApp.ScreenUpdating = True
	CleanUp([wb,xlApp])
	return None

try:
	errorReport = None
	if runMe:
		message = None
		try:
			dataOut = []
			xlApp = SetUp(Excel.ApplicationClass())
			if os.path.isfile(unicode(filePath)):
				xlApp.Workbooks.open(unicode(filePath))
				wb = xlApp.ActiveWorkbook
				for i in range(0, xlApp.Sheets.Count, 1):
					dataOut.append(xlApp.Sheets(i+1).Name)
			ExitExcel(xlApp, wb)
		except:
			xlApp.Quit()
			Marshal.ReleaseComObject(xlApp)
			pass
	else:
		errorReport = "Set RunMe to True."
except:
		# if error accurs anywhere in the process catch it
		import traceback
		errorReport = traceback.format_exc()

#Assign your output to the OUT variable
if errorReport == None:
	OUT = dataOut
else:
	OUT = errorReport
# ----------------------------------------
OUT = Output(python_script)
