# Dynamo graph _clearContents.dyn (Dynamo 0.8.0.950)

file_path = Filename("D:\Stuff\Dynamo\076-GetBuiltInParameters\TestSheetParam.xlsx")
boolean = BoolSelector(true)
code_block = CodeBlock { "Sheet1"; }
boolean_2 = BoolSelector(false)
boolean_3 = BoolSelector(true)
clear_contents = Custom[Clear Contents](FilePath=file_path, RunIt=boolean, SheetName=code_block, ClearContent=boolean_2, ClearFormatting=boolean_3)  # This node will allow you to either clear cell contents from a file or just the formatting (cell fills, text styles etc).
watch = Watch(clear_contents)
code_block_2 = CodeBlock { "A1:B50"; }
