# Dynamo graph _pieChart_01.dyn (Dynamo 0.8.0.950)

boolean = BoolSelector(true)
code_block = CodeBlock { "Sheet2"; "F3:X37"; "Wall Type Usage"; "A1:A24"; }
pie_chart_types = Custom[Pie Chart Types]()  # This node will return all pie chart types that can be generated using bumblebee Pie Chart node.
code_block_2 = CodeBlock(IN=pie_chart_types) { IN[2]; }
legend_position_types = Custom[Legend Position Types]()  # This node will query up all available legend positions that can be used with Charts.
code_block_3 = CodeBlock(IN=legend_position_types) { IN[3]; }
code_block_4 = CodeBlock { "B1:B24"; }
legend_style = Custom[Legend Style](LegendPosition=code_block_3, LegendLabels=code_block_4)  # This node will generate a style to visually format a chart legend.
line_types = Custom[Line Types]()  # This node will return all Line Types that are available for use with Excel.
line_weight_type = Custom[Line Weight Type]()  # This node will return all Line Weight Types that are available for use in Excel
code_block_5 = CodeBlock(IN=line_types, IN1=line_weight_type) { IN[3]; IN1[2]; }
colourUI = nColorPicker()
border_style = Custom[Border Style](LineType=code_block_5.out0, LineWeightType=code_block_5.out1, LineColor=colourUI)  # This node can be used to change default formatting of Excel cells using Format Excel of Conditionally Format Excel Nodes.
boolean_2 = BoolSelector(true)
chart_style = Custom[Chart Style](BorderStyle=border_style, RoundedCorners=boolean_2)  # This node will generate a style that can be used to format a chart.
pattern_types = Custom[Pattern Types]()  # This node will return all pattern types available in Excel.
code_block_6 = CodeBlock(IN=pattern_types) { IN[18]; }
colourUI_2 = nColorPicker()
colourUI_3 = nColorPicker()
fill_style = Custom[Fill Style](PatternType=code_block_6, BackgroundColor=colourUI_2, PatternColor=colourUI_3)  # This node generates a Fill Style that can be used for conditional formatting or regular cell formatting.
code_block_7 = CodeBlock { "Myriad Pro"; "10"; }
colourUI_4 = nColorPicker()
code_block_8 = CodeBlock { true; false; false; false; }
text_style = Custom[Text Style](Name=code_block_7.out0, Size=code_block_7.out1, FontColor=colourUI_4, Bold=code_block_8.out0, Italic=code_block_8.out1, Underline=code_block_8.out2, Strikethrough=code_block_8.out3)  # This node will generate a text style that can be used to format excel or with conditional formatting.
code_block_9 = CodeBlock { true; true; true; true; false; ","; }
label_position_types = Custom[Label Position Types]()  # This node will return all currently available position types that can e assign to labels on a chart.
code_block_10 = CodeBlock(IN=label_position_types) { IN[2]; }
label_style = Custom[Label Style](TextStyle=text_style, ShowSeriesName=code_block_9.out0, ShowValue=code_block_9.out1, ShowPercentage=code_block_9.out2, ShowLeaderLines=code_block_9.out3, ShowLegendKey=code_block_9.out4, Separator=code_block_9.out5, LabelPosition=code_block_10)  # This node will generate a style that can be used to format labels on a chart.
code_block_11 = CodeBlock { 50; }
graph_style = Custom[Graph Style](FillStyle=fill_style, LabelStyle=label_style, Explosion=code_block_11)  # This node will generate a style that can be used to control appearance of the graph portion of the chart.
pie_chart = Custom[Pie Chart](RunIt=boolean, SheetName=code_block.out0, SizeRange=code_block.out1, Title=code_block.out2, DataRange=code_block.out3, PieChartType=code_block_2, LegendStyle=legend_style, ChartStyle=chart_style, GraphStyle=graph_style)  # This node will generate a new Pie Chart in your currently running session of Excel.
watch = Watch(pie_chart)
watch_2 = Watch(legend_position_types)
