# Dynamo graph _readExcel.dyn (Dynamo 0.8.0.950)

file_path = Filename("C:\Users\ksobon\Desktop\_testExcelExport_01.xlsx")
boolean = BoolSelector(true)
code_block = CodeBlock { "Sheet1"; }
boolean_2 = BoolSelector(true)
read_excel = Custom[Read Excel](File_Path=file_path, RunIt=boolean, SheetName=code_block, ByColumn=boolean_2)  # This node will read an excel file. You can read an entore sheet contents, read from specific origin cell, read only specific range, or do all of the former for multiple sheets at the same time.
watch = Watch(read_excel)
