# Dynamo graph _liveLinkExcel_01.dyn (Dynamo 0.8.0.950)

boolean = BoolSelector(true)
boolean_2 = BoolSelector(true)
code_block = CodeBlock { "TestSheet1"; }
code_block_2 = CodeBlock { "A1"; }
code_block_3 = CodeBlock { {0..20, 10..20}; }
bb_data = Custom[BB Data](SheetName=code_block, Origin=code_block_2, Data=code_block_3)  # This node is a building block for different modes of writing to Excel files. You can combines this node into a list to write to multiple sheets or use just one to write to a single sheet.
code_block_4 = CodeBlock { "TestSheet2"; }
code_block_5 = CodeBlock { "A1"; }
code_block_6 = CodeBlock { {0..20, 10..20}; }
bb_data_2 = Custom[BB Data](SheetName=code_block_4, Origin=code_block_5, Data=code_block_6)
code_block_7 = CodeBlock { "TestSheet45"; }
code_block_8 = CodeBlock { "D1"; }
code_block_9 = CodeBlock { {0..20, 10..20}; }
bb_data_3 = Custom[BB Data](SheetName=code_block_7, Origin=code_block_8, Data=code_block_9)
create = List.Create(bb_data, bb_data_2, bb_data_3)
live_write_excel = Custom[Live Write Excel](RunIt=boolean, ByColumn=boolean_2, BBData=create)  # This node will allow you to write to Excel file that is currently open and you will be able to see the results of your data stream live in excel.
watch = Watch(live_write_excel)
