# Dynamo graph _3color.dyn (Dynamo 0.8.0.950)

file_path = Filename("D:\Stuff\Dynamo\076-GetBuiltInParameters\TestSheetParam.xlsx")
boolean = BoolSelector(true)
code_block = CodeBlock { "Sheet1"; }
code_block_2 = CodeBlock { "J8:S21"; }
condition_value_type = Custom[Condition Value Type]()  # This node will return all Condition Value Types that are available for use with Excel.
code_block_3 = CodeBlock(IN=condition_value_type) { IN[0]; IN[2]; 50; IN[5]; }
colourUI = nColorPicker()
colourUI_2 = nColorPicker()
colourUI_3 = nColorPicker()
n3_color_scale_format_condition = Custom[(3) Color Scale Format Condition](MinValueType=code_block_3.out0, MinColor=colourUI, MidValueType=code_block_3.out1, MidValue=code_block_3.out2, MidColor=colourUI_2, MaxValueType=code_block_3.out3, MaxColor=colourUI_3)  # This node will generate a three (3) color scheme that can be used to format a range of numbers in Excel.
conditionally_format_excel = Custom[Conditionally Format Excel](FilePath=file_path, RunIt=boolean, SheetName=code_block, CellRange=code_block_2, FormatConditions=n3_color_scale_format_condition)  # This node will allow you to apply conditional formatting to an Excel document or a specific range within the document.
watch = Watch(conditionally_format_excel)
code_block_4 = CodeBlock { "=LEN(TRIM(C1))=0"; }
pattern_types = Custom[Pattern Types]()  # This node will return all pattern types available in Excel.
code_block_5 = CodeBlock(IN=pattern_types) { IN[13]; }
code_block_6 = CodeBlock { 1; 255; 255; 255; }
byARGB = Color.ByARGB(a=code_block_6.out0, r=code_block_6.out1, g=code_block_6.out2, b=code_block_6.out3)
code_block_7 = CodeBlock { 1; 255; 0; 210; }
byARGB_2 = Color.ByARGB(a=code_block_7.out0, r=code_block_7.out1, g=code_block_7.out2, b=code_block_7.out3)
fill_style = Custom[Fill Style](PatternType=code_block_5, BackgroundColor=byARGB, PatternColor=byARGB_2)  # This node generates a Fill Style that can be used for conditional formatting or regular cell formatting.
graphic_style = Custom[Graphic Style](FillStyle=fill_style)  # This node will create a graphic style that can be used either for conditional formatting or regular cell formatting.
expression_format_condition = Custom[Expression Format Condition](Expression=code_block_4, GraphicStyle=graphic_style)  # This node will generate an expression based formatting condition that can be used with Conditionally Format Excel Node.
operator_types = Custom[Operator Types]()  # This node returns all operator types available in Excel.
code_block_8 = CodeBlock(IN=operator_types) { IN[0]; }
code_block_9 = CodeBlock { "Author"; }
cell_value_format_condition = Custom[Cell Value Format Condition](OperatorType=code_block_8, Values=code_block_9, GraphicStyle=graphic_style)  # This node creates a format condition based on a cell value.
create = List.Create(expression_format_condition, cell_value_format_condition)
watch_2 = Watch(condition_value_type)
