# Dynamo graph _dataBar.dyn (Dynamo 0.8.0.950)

file_path = Filename("D:\Stuff\Dynamo\076-GetBuiltInParameters\TestSheetParam.xlsx")
boolean = BoolSelector(true)
code_block = CodeBlock { "Sheet1"; }
code_block_2 = CodeBlock { "J8:S21"; }
condition_value_type = Custom[Condition Value Type]()  # This node will return all Condition Value Types that are available for use with Excel.
code_block_3 = CodeBlock(IN=condition_value_type) { IN[7]; IN[6]; }
direction_types = Custom[Direction Types]()  # This node returns all direction types available in Excel.
code_block_4 = CodeBlock(IN=direction_types) { IN[1]; }
boolean_2 = BoolSelector(false)
colourUI = nColorPicker()
colourUI_2 = nColorPicker()
data_bar_format_condition = Custom[Data Bar Format Condition](MinType=code_block_3.out0, MaxType=code_block_3.out1, DirectionType=code_block_4, GradientFill=boolean_2, FillColor=colourUI, BorderColor=colourUI_2)  # This node will generate a Data Bar format condition. Based on range of numbers a small bar will be placed in a cell that graphically represents the value contained within the cell.
conditionally_format_excel = Custom[Conditionally Format Excel](FilePath=file_path, RunIt=boolean, SheetName=code_block, CellRange=code_block_2, FormatConditions=data_bar_format_condition)  # This node will allow you to apply conditional formatting to an Excel document or a specific range within the document.
watch = Watch(conditionally_format_excel)
watch_2 = Watch(condition_value_type)
watch_3 = Watch(direction_types)
