# Dynamo graph _topBottom.dyn (Dynamo 0.8.0.950)

file_path = Filename("D:\Stuff\Dynamo\076-GetBuiltInParameters\TestSheetParam.xlsx")
boolean = BoolSelector(true)
code_block = CodeBlock { "Sheet1"; }
code_block_2 = CodeBlock { "J8:S21"; }
boolean_2 = BoolSelector(false)
code_block_3 = CodeBlock { 15; }
boolean_3 = BoolSelector(true)
colourUI = nColorPicker()
fill_style = Custom[Fill Style](BackgroundColor=colourUI)  # This node generates a Fill Style that can be used for conditional formatting or regular cell formatting.
graphic_style = Custom[Graphic Style](FillStyle=fill_style)  # This node will create a graphic style that can be used either for conditional formatting or regular cell formatting.
top_bottom_percentile_format = Custom[Top Bottom Percentile Format Condition](Percent=boolean_2, Rank=code_block_3, Top=boolean_3, GraphicStyle=graphic_style)  # This node will generate a Formatting Condition based on the top/bottom ranked values. It can either be top percentile (0-100) or number of top/bottom ranked values (top 10 values for example).
conditionally_format_excel = Custom[Conditionally Format Excel](FilePath=file_path, RunIt=boolean, SheetName=code_block, CellRange=code_block_2, FormatConditions=top_bottom_percentile_format)  # This node will allow you to apply conditional formatting to an Excel document or a specific range within the document.
watch = Watch(conditionally_format_excel)
code_block_4 = CodeBlock { "=LEN(TRIM(C1))=0"; }
pattern_types = Custom[Pattern Types]()  # This node will return all pattern types available in Excel.
code_block_5 = CodeBlock(IN=pattern_types) { IN[13]; }
code_block_6 = CodeBlock { 1; 255; 255; 255; }
byARGB = Color.ByARGB(a=code_block_6.out0, r=code_block_6.out1, g=code_block_6.out2, b=code_block_6.out3)
code_block_7 = CodeBlock { 1; 255; 0; 210; }
byARGB_2 = Color.ByARGB(a=code_block_7.out0, r=code_block_7.out1, g=code_block_7.out2, b=code_block_7.out3)
fill_style_2 = Custom[Fill Style](PatternType=code_block_5, BackgroundColor=byARGB, PatternColor=byARGB_2)
graphic_style_2 = Custom[Graphic Style](FillStyle=fill_style_2)
expression_format_condition = Custom[Expression Format Condition](Expression=code_block_4, GraphicStyle=graphic_style_2)  # This node will generate an expression based formatting condition that can be used with Conditionally Format Excel Node.
operator_types = Custom[Operator Types]()  # This node returns all operator types available in Excel.
code_block_8 = CodeBlock(IN=operator_types) { IN[0]; }
code_block_9 = CodeBlock { "Author"; }
cell_value_format_condition = Custom[Cell Value Format Condition](OperatorType=code_block_8, Values=code_block_9, GraphicStyle=graphic_style_2)  # This node creates a format condition based on a cell value.
create = List.Create(expression_format_condition, cell_value_format_condition)
